% Simulink data dictionary objDict.sldd

FeedBack_st = Simulink.Bus()  % Структура с сигналами обратных связей
  Vin2: single
  Vin: single
  Iin: single
  Iout: single
  Vout: single
  Temp: single

Control_st = Simulink.Bus()  % Структура с сигналами управления преобразователем
  PWM_ref: single
  Ena: uint16
  OPTO_1: uint16
  OPTO_2: uint16
  OPTO_3: uint16

Vout_ref = Simulink.Signal(StorageClass="Struct", StructName="SystemSignals", DataType="single")
Iref_lim = Simulink.Signal(StorageClass="Struct", StructName="SystemSignals", DataType="single")
Iref = Simulink.Signal(StorageClass="Struct", StructName="SystemSignals", DataType="single")
V_pwm = Simulink.Signal(StorageClass="Struct", StructName="SystemSignals", DataType="single")
PWM_ref = Simulink.Signal(StorageClass="Struct", StructName="SystemSignals", DataType="single")